vi "index.gviweb"   [LabVIEW NXG 4.0.0]
panel controls:
  "Polarity": bool
panel indicators:
  "Numeric": f64
  "URL Image": string
diagram:
  # Place setup code before the loop. For example, perform initial data communication and wire the results into the loop.
  Property Node(instance in=reference to "URL Image", "Visible"=FALSE) -> (error out=w1)
  # Top-Level WebVIs usually contain a While Loop that never stops so that they can continue running as long as the web page is open in the user's web browser.
  while (after w1) {
    w2 = "https://ctl.s6img.com/society6/img/tI_RKGBQioiuuhsx69smQhFeuKw/w_700/metal-prints/1x1/front/~artwork/s6-original-art-uploads/society6/uploads/misc/b6816f34b6404ecd9f92e113befa1b9f/~~/doge-meme-metal-prints.jpg"
    $"URL Image" <- w2
    Random Number() -> (number (0 to 1)=w3)
    Multiply(w3, 100) -> w4
    case ($Polarity) {
      frame False, Default {
        Property Node(instance in=reference to "URL Image", "Visible"=FALSE)
        Negate(x=w4) -> w5
      }
      frame True {
        Property Node(instance in=reference to "URL Image", "Visible"=TRUE)
        w5 = w4
      }
    }
    Round To Nearest(number=w5) -> w6
    $Numeric <- w6
    Wait(time to wait=100)
    stop if FALSE
  }
